# Grasshopper definition gensim_gh_02.gh (Grasshopper 1.0.8)
# plug-ins: RhinoCodePluginGH

path = FilePath("D:\Dropbox\ACADEMIC\GSD\2024_02_Fall_QA\04_language\scripts\the_origin_of_species.kv")
panel = Panel(path)
py3 = Python3Script(model_path=path)  # -> out, model, vec_size; disabled
# ---------- py3: Python ----------
# requirements: gensim

import gensim
from gensim.models import KeyedVectors
import logging

#need this to avoid SSL certificate error when downloading models from gensim api. Especially on MacOS
import ssl
ssl._create_default_https_context = ssl._create_unverified_context
logging.basicConfig(format='%(asctime)s : %(levelname)s : %(message)s', level=logging.INFO)

model  = KeyedVectors.load(model_path, mmap='r')
vec_size = model.vector_size
# ---------- end py3 ----------
panel_2 = Panel(py3.vec_size)

py3_2 = Python3Script()  # -> out, models
# ---------- py3_2: Python ----------
# requirements: gensim

import gensim
import gensim.downloader as api
import logging

#need this to avoid SSL certificate error when downloading models from gensim api. Especially on MacOS
import ssl
ssl._create_default_https_context = ssl._create_unverified_context

models = []
#list all available models
info = api.info()
for model_name, model_data in sorted(info['models'].items()):
    models.append(model_name)
# ---------- end py3_2 ----------
panel_3 = Panel(py3_2.models)
item = ListItem(List=py3_2.models, Index=Slider(10, range=0..10), Wrap=True)
panel_4 = Panel(item)
py3_3 = Python3Script(model_name=item)  # -> out, model, vec_size
# ---------- py3_3: Python ----------
# requirements: gensim

import gensim
import gensim.downloader as api
import logging

#need this to avoid SSL certificate error when downloading models from gensim api. Especially on MacOS
import ssl
ssl._create_default_https_context = ssl._create_unverified_context
logging.basicConfig(format='%(asctime)s : %(levelname)s : %(message)s', level=logging.INFO)

model  = api.load(model_name)
vec_size = model.vector_size
# ---------- end py3_3 ----------
panel_5 = Panel(py3_3.vec_size)

py3_4 = Python3Script(model=py3.model, word="cat")  # -> out, a
# ---------- py3_4: Python ----------
import numpy as np

vec = model.get_vector(word, True)
a = vec.tolist()
# ---------- end py3_4 ----------

graph = QuickGraph(py3_4.a, SortOrder=0)
panel_6 = Panel(py3_4.a)
gradient = Gradient(
    LowerLimit=-1,
    UpperLimit=1,
    Parameter=py3_4.a,
    stops=[0.302: RGB(255, 117, 107), 0.496: RGB(255, 255, 255), 0.704: RGB(0, 153, 173)])

py3_5 = Python3Script(model=py3_3.model, word="cat")  # -> out, a; same code as py3_4

graph_2 = QuickGraph(py3_5.a, SortOrder=0)
panel_7 = Panel(py3_5.a)
gradient_2 = Gradient(
    LowerLimit=-1,
    UpperLimit=1,
    Parameter=py3_5.a,
    stops=[0.302: RGB(255, 117, 107), 0.496: RGB(255, 255, 255), 0.704: RGB(0, 153, 173)])

py3_6 = Python3Script(vec=py3_4.a, scale=Slider(10, range=0..10))  # -> out, points, pline, curve; inputs vec: list
# ---------- py3_6: Python ----------
import Rhino.Geometry as r

points = []
for i in range(len(vec)):
    p = r.Point3d(i, vec[i] * scale, 0.0)
    points.append(p)

pline = r.Polyline(points)
curve = r.Curve.CreateInterpolatedCurve(points, 3)
# ---------- end py3_6 ----------
preview = CustomPreview(Geometry=py3_6.curve, Material=ColourSwatch(SwatchColor=RGB(0, 0, 0)))
preview_2 = CustomPreview(Geometry=py3_6.points, Material=gradient)

subtraction = Subtraction(A=py3.vec_size, B=Slider(1, range=0..1))
mplane = MeshPlane(
    Boundary={Plane=PlaneXY(24.53684749, 2.576302878, 0), Size=Domain2(u=-24.53684749..24.53684749, v=-2.576302878..2.576302878)},
    WidthCount=subtraction,
    HeightCount=1)  # -> Mesh, Area
mcol = MeshColours(Mesh=mplane.Mesh, Colours=gradient)

py3_7 = Python3Script(vec=py3_5.a, scale=Slider(10, range=0..10))  # -> out, points, pline, curve; inputs vec: list; same code as py3_6
preview_3 = CustomPreview(Geometry=py3_7.curve, Material=ColourSwatch(SwatchColor=RGB(0, 0, 0)))
preview_4 = CustomPreview(Geometry=py3_7.points, Material=gradient_2)

subtraction_2 = Subtraction(A=py3_3.vec_size, B=Slider(1, range=0..1))
mplane_2 = MeshPlane(
    Boundary={Plane=PlaneXY(24.53684749, 2.576302878, 0), Size=Domain2(u=-24.53684749..24.53684749, v=-2.576302878..2.576302878)},
    WidthCount=subtraction_2,
    HeightCount=1)  # -> Mesh, Area
mcol_2 = MeshColours(Mesh=mplane_2.Mesh, Colours=gradient_2)
